# Grasshopper definition knitting_machine_postprocess.gh (Grasshopper 1.0.7)

# ---- group: write the data from the image (pixels)
pixels = Slider(122, range=0..1000)
pixels_2 = Slider(273, range=0..1000)
height = Number(pixels_2)
width = Number(pixels)

# ----
# import internalised data from the last component  - pixeldata
# import instead of this one and connect text to text
pixeldata = Data(Tree({0}: ["Grasshopper.Kernel.Types.GH_ObjectWrapper"], {1}: ["Grasshopper.Kernel.Types.GH_ObjectWrapper"], {2}: ["Grasshopper.Kernel.Types.GH_ObjectWrapper"], {3}: ["Grasshopper.Kernel.Types.GH_ObjectWrapper"], {4}: ["Grasshopper.Kernel.Types.GH_ObjectWrapper"], {5}: ["Grasshopper.Kernel.Types.GH_ObjectWrapper"]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))
txt = Text(pixeldata)

# ---- group: extracting useful information
txt_2 = Text(Tree({0}: ["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"], {1}: ["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"], {2}: ["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"], {3}: ["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"], {4}: ["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"], {5}: ["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"]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))
panel = Panel(txt_2)
extract_colors = ExtractColors(txt=txt_2)  # disabled

# ----
# if its too heavy(string operations eat a lot...) you can internalise this component and disable stuff connected before
# I disconnected it for now.
# just enable and connect to colors :)
colors = Data(Tree({0;0}: [RGB(217, 217, 217)], {0;1}: [RGB(217, 217, 217)], {0;2}: [RGB(217, 217, 217)], {0;3}: [RGB(217, 217, 217)], {0;4}: [RGB(217, 217, 217)], {0;5}: [RGB(217, 217, 217)]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))
weird_color_that_should_b_removed = Data(RGB(157, 0, 255))

# ---- group: alphabet of colors and their abstract values
blue_end_of_the_line = Data(RGB(0, 136, 255))
purple_decrease = Data(RGB(191, 61, 242))
blue_increase = Data(RGB(0, 255, 195))
grey = Data(RGB(217, 217, 217))
red = Data(RGB(230, 41, 41))
panel_2 = Panel(red)
panel_3 = Panel(blue_increase)
panel_4 = Panel(purple_decrease)
panel_5 = Panel(grey)
panel_6 = Panel(blue_end_of_the_line)
int = Integer("2")
int_2 = Integer("0")
int_3 = Integer("4")
int_4 = Integer("3")
int_5 = Integer("1")

# ----
panel_7 = Panel(weird_color_that_should_b_removed)
rep = ReplaceText(Text=colors, Find=panel_7, Replace=panel_2, RecursiveReplace=False)
after_removing_weird_color = Data(rep)

# ---- group: additional stuff
# You can use this for some other post-process, maybe with visual programming
rep_2 = ReplaceText(Text=after_removing_weird_color, Find=panel_2, Replace=int, RecursiveReplace=False)
rep_3 = ReplaceText(Text=rep_2, Find=panel_3, Replace=int_4, RecursiveReplace=False)
rep_4 = ReplaceText(Text=rep_3, Find=panel_5, Replace=int_2, RecursiveReplace=False)
rep_5 = ReplaceText(Text=rep_4, Find=panel_6, Replace=int_5, RecursiveReplace=False)
rep_6 = ReplaceText(Text=rep_5, Find=panel_4, Replace=int_3, RecursiveReplace=False)
data = Data(rep_6)
int_6 = Integer(data)
trim = TrimTree(Tree=int_6, Depth=1)
tstat = TreeStatistics(Tree=trim)  # -> Paths, Length, Count
branch = TreeBranch(Tree=trim, Path=Slider(0, range=0..272), MaintainPaths=True)
abstract_colors = Data(trim)
from_abstract_to_colors = GhPythonScript(list=abstract_colors)  # -> out, nested_colors2; inputs list: tree of Int32
# ---------- from_abstract_to_colors: Python ----------
__author__ = "ang"
__version__ = "2022.07.20"

import rhinoscriptsyntax as rs
import ghpythonlib.treehelpers as ght

#COLOR ALPHABET
s2 = '230,41,41' #RED
s3 = '0,255,195' #BLUE INCREASE
s0 = '217,217,217' #GREY
s1 = '0,136,255' #BLUE END OF LINE
s4 = '191,61,242' #PURPLE DECREASE

nested_colors2=[]
#TRANSFORM GH DATA TREE TO A PYTHON NESTED LEST
nested = ght.tree_to_list(list,0)

#CONVERT ABSTRACTED COLORS TO THE REAL COLORS
for list_end in nested:
    #print(list)
    for i in list_end:
        n = i
        ind = list_end.index(i)
        if n == 2:
            #i = 2
            list_end[ind] = s2
        if n == 1:
            #i = 1
            list_end[ind] = s1
        if n == 0:
            #i = 0
            list_end[ind] = s0
        if n == 4:
            #i = 4
            list_end[ind] = s4
        if n == 3:
            #i = 3
            list_end[ind] = s3
            
nested_colors2 = nested
# ---------- end from_abstract_to_colors ----------
c_script = CSharpScript(x=from_abstract_to_colors.nested_colors2)  # -> out, simplify(A)
# ---------- c_script: C# ----------
    A = x;
# ---------- end c_script ----------

# ---- group: post-process. main part
trim_2 = TrimTree(Tree=after_removing_weird_color, Depth=1)
post_process = GhPythonScript(list=trim_2)  # -> out, nested_colors; inputs list: tree
# ---------- post_process: Python ----------
__author__ = "ang"
__version__ = "2022.07.20"

import rhinoscriptsyntax as rs
import ghpythonlib.treehelpers as ght
import copy

#TRANSFORM GH DATA TREE TO A PYTHON NESTED LEST
nested = ght.tree_to_list(list,0)


#OUTPUT
nested_colors=[]

#COLOR ALPHABET
s2 = '230,41,41' #RED
s3 = '0,255,195' #BLUE INCREASE
s0 = '217,217,217' #GREY
s1 = '0,136,255' #BLUE END OF LINE
s4 = '191,61,242' #PURPLE DECREASE

#ABSTRACT COLORS TO NUMBERS

for list in nested:
    #print(list)
    ind=0
    for i in list:
        n = i
        #ind = list.index(i)
        if n == s2:
            #i = 2
            list[ind] = 2
        if n == s1:
            #i = 1
            list[ind] = 1
        if n == s0:
            #i = 0
            list[ind] = 0
        if n == s4:
            #i = 4
            list[ind] = 4
        if n == s3:
            #i = 3
            list[ind] = 3
        ind+=1

nestedlist_num=nested[:]


nestedlist_num2 = nestedlist_num[:]

# REMOVE DUPLICATED INCREASE AND DECREASE
for list in nestedlist_num2:
    #print(list)
    if 4 in list and 3 in list:
        list4_index=[]
        list3_index=[]
        indx=0
        for m in list:
            if m ==4:
               list4_index.append(indx)
            if m ==3:
               list3_index.append(indx)
            indx+=1
        #print(list4_index, 'list4_index')
        #print(list3_index, 'list3_index')
        
        if len(list4_index) == len(list4_index):
            for h in list4_index:
                list[h] = 2
            for k in list3_index:
                list[k] = 2
        else:
            difference= abs(len(list4_index)-len(list4_index))
            print('update this part of the code. its missing')
            a = list.index(4)
            b = list.index(3)
            list[a]=2
            list[b]=2



lastitem = (len(nestedlist_num2))-1
all_endcolors=[]
# REMOVE GREY PARTS IN THE MIDDLE
for i in range(len(nestedlist_num2)):
    endcol=[]
    indi=0
    listi = nestedlist_num2[i]
    for a in listi:
        if a == 1:
            endcol.append(indi)
        indi +=1
    middle = []
    if(len(endcol))>3:
        middle = endcol
        endcol=[]
        endcol.append(middle[0])
        middle.pop(0)
        last= (len(middle))-1
        endcol.append(middle[last])
        middle.pop(last)
        #print(middle, 'mid')
        #print(endcol, 'endcol')
        start_mid = middle[0]
        end_mid = middle[1] 
        #print(start_mid, 'start')
        #print(end_mid, 'end_mid')
        change = range(start_mid,end_mid+1)
        #print(change)
        for s in change:
            (nestedlist_num2[i])[s] = 2
    all_endcolors.append(endcol)
#print(all_endcolors)

#REMOVE THE MISTAKE OF DISCONNECTED ISLANDS
for d in range(len(all_endcolors)-1):
    d1= all_endcolors[d]
    start = d1[0]
    end = d1[1]
    
    startbefore = (all_endcolors[d-1])[0]
    endbefore = (all_endcolors[d-1])[1]
    #print(before)
    startafter= (all_endcolors[d+1])[0]
    endafter= (all_endcolors[d+1])[0]
    #print(after)
    difference = end-start
    if difference <5:
        #print('lalala')
        startdist = abs(int((startbefore-startafter)/2) - start)
        enddist = abs(int((endbefore-endafter)/2) - end)
        #print(startdist, enddist)
        if startdist<enddist:
            averageendindex = int((endbefore-endafter)/2)
            range_new = range(end-1, averageendindex)
            (nestedlist_num2[d])[averageendindex] = 1
            (all_endcolors[d])[1] = averageendindex
            #print(range_new)
            for m in range_new:
                (nestedlist_num2[d])[m] = 2
        else:
            print('update this part of the code, its missing3')


#DO ALL THE ROWS CHANGE IN 2
for i in range(len(nestedlist_num2)):
    if i % 2 == 0 and i<lastitem:
        next= i+1
        list_even = nestedlist_num2[i]
        list_uneven = nestedlist_num2[next]
        endcol_even = all_endcolors[i]
        endcol_uneven = all_endcolors[next]
        #print(endcol_even, 'endcol_even')
        #print(endcol_uneven, 'endcol_uneven')
        if endcol_even[0] != endcol_uneven[0] or endcol_even[1] != endcol_uneven[1]:
            startev = endcol_even[0]
            endev = endcol_even[1]
            startunev = endcol_uneven[0]
            endunev = endcol_uneven[1]
            if startev != startunev:
                
                if startunev >startev:
                    (nestedlist_num2[next])[startev] = 1
                    rang= range(startev+1, startunev+1)
                    for f in rang:
                        #print(f)
                        #print((nestedlist_num2[next])[f])
                        (nestedlist_num2[next])[f] = 2
                if startev >startunev:
                    (nestedlist_num2[next])[startev] = 1
                    rang= range(startunev, startev)
                    for f in rang:
                        (nestedlist_num2[next])[f] = 0
            
            if endev != endunev:
                if endunev >endev:
                    (nestedlist_num2[next])[endev] = 1
                    rang= range(endev+1, endunev+1)
                    for f in rang:
                        #print(f)
                        #print((nestedlist_num2[next])[f])
                        (nestedlist_num2[next])[f] = 0
                if endev >endunev:
                    (nestedlist_num2[next])[endev] = 1
                    rang= range(endunev, endev)
                    for f in rang:
                        (nestedlist_num2[next])[f] = 2
                #print(endcol_even[0], endcol_uneven[0])
                #for
            #if endcol_even[1] != endcol_uneven[1]:
                #print('ok')
            #print('uups')

# INCREASE AND DECREASE LINES FROM THE POINTS.. GOING TO THE SIDE THAT IS MORE DEFORMED

#decide what side is more deformed 
leftgrey=[]
rightgrey=[]
for v in nestedlist_num2:
    length= len(v)-1
    left = v[0]
    right = v[length]
    leftgrey.append(left)
    rightgrey.append(right)
leftsum= sum(leftgrey)
rightsum= sum(rightgrey)
#print(leftsum, 'leftgrey')
#print(rightsum, 'rightgrey')

if(leftsum<=rightsum):
    i=0
    for n in nestedlist_num2:
        ind4=[]
        ind3=[]
        if 4 in n:
            
            for o in range(len(n)):
                if n[o] ==4:
                    ind4.append(o)
            ind4max= max(ind4)+1
            rang=range(0,ind4max)
            for e in rang:
                item=n[e]
                if item>0:
                    (nestedlist_num2[i])[e] = 4
        if 3 in n:
            for o in range(len(n)):
                if n[o] ==3:
                    ind3.append(o)
            ind3max= max(ind3)+1
            rang2=range(0,ind3max)
            for e2 in rang2:
                item2=n[e2]
                if item2>0:
                    (nestedlist_num2[i])[e2] = 3
        i+=1
if(leftsum>rightsum):
    print('update this part of the code, its missing2')



nested_out=nestedlist_num2[:]
nested_out2=nested_out[:]

#CONVERT ABSTRACTED COLORS TO THE REAL COLORS
for list_end in nested_out2:
    #print(list)
    for i in list_end:
        n = i
        ind = list_end.index(i)
        if n == 2:
            #i = 2
            list_end[ind] = s2
        if n == 1:
            #i = 1
            list_end[ind] = s1
        if n == 0:
            #i = 0
            list_end[ind] = s0
        if n == 4:
            #i = 4
            list_end[ind] = s4
        if n == 3:
            #i = 3
            list_end[ind] = s3
            
nested_colors = nested_out2[:]
# ---------- end post_process ----------
c_script_2 = CSharpScript(x=post_process.nested_colors)  # -> out, simplify(A); same code as c_script
colors_2 = Data(c_script_2.A)

# ---- group: preview. to see the result of post process connect colors from post process to material
width_2 = Number(width)  # disabled
height_2 = Number(height)  # disabled
series = Series(Start=0, Step=1, Count=height_2)  # disabled
series_2 = Series(Start=0, Step=1, Count=width_2)  # disabled
pt = ConstructPoint(XCoordinate=series_2, YCoordinate=graft(series), ZCoordinate=0)  # -> simplify(Point); disabled
graft = GraftTree(Tree=pt, IncludeEmptyLists=True, IncludeNullItems=True)  # disabled
dots = DotDisplay(Point=graft, Colour=graft(after_removing_weird_color), Size=1)  # disabled

# ---- group: create and write bitmap
data_2 = Data(colors_2)
tstat_2 = TreeStatistics(Tree=data_2)  # -> Paths, Length, Count
panel_8 = Panel(data_2)
rev = ReverseList(List=tstat_2.Paths)
replace = ReplacePaths(Data=data_2, Search=tstat_2.Paths, Replace=rev)
flatten = FlattenTree(Tree=replace, Path="{0}")
int_7 = Integer(width)
write_file = BooleanToggle(False)
int_8 = Integer(height)
col = Colour(flatten)
path = FilePath("D:\HVA\tut\wetransfer_angelina_2022-07-12_1245\Angelina\TRY16.bmp")
c_script_3 = CSharpScript(Width=int_7, Height=int_8, Colours=col, Filename=path, BOOL=write_file)  # -> out, A; inputs Width: Int32, Height: Int32, Colours: list of Color, Filename: String, BOOL: Int32
# ---------- c_script_3: C# usings ----------
using System.Drawing;
using System.Drawing.Imaging;
# ---------- c_script_3: C# ----------
  if(BOOL>0)
  {
  Bitmap image = new Bitmap(Width, Height, PixelFormat.Format32bppArgb);

  int index = 0;
  for (int j = 0; j < Height; j++)
    for (int i = 0; i < Width; i++)
    {
    image.SetPixel(i, j, Colours[index]);
    index = (index + 1);
    }

    image.Save(Filename);
    image.Dispose();
  }
# ---------- end c_script_3 ----------

# ==== cluster ExtractColors
txt = ClusterInput()
txt_2 = Text(txt)
split = TextSplit(Text=txt_2, Separators="<System.Drawing.Color object at")
len = TextLength(Text=split)
larger = LargerThan(FirstNumber=len, SecondNumber="0")  # -> LargerThan, OrEqualTo
cull = CullPattern(List=split, CullPattern=larger.LargerThan)
clean_tree = CleanTree(RemoveNulls=True, RemoveInvalid=True, RemoveEmpty=True, Tree=cull)  # -> simplify(Tree)
chars = Characters(Text=clean_tree)  # -> Result, Unicode
tmatch = MatchText(Text=chars.Result, Pattern="A", Case=True)
rep = ReplaceText(Text=clean_tree, Find=simplify("("), RecursiveReplace=False)
panel = Panel(tmatch)
rep_2 = ReplaceText(Text=rep, Find=simplify("["), RecursiveReplace=False)
rep_3 = ReplaceText(Text=rep_2, Find=simplify("]]>,"), RecursiveReplace=False)
rep_4 = ReplaceText(Text=rep_3, Find=simplify("]]>)"), RecursiveReplace=False)
rep_5 = ReplaceText(Text=rep_4, Find=simplify(","), RecursiveReplace=False)
len_2 = TextLength(Text=rep_5)
smaller = SmallerThan(FirstNumber=len_2, SecondNumber="10")  # -> SmallerThan, OrEqualTo
cull_2 = CullPattern(List=rep_5, CullPattern=smaller.SmallerThan)
panel_2 = Panel(len_2)
len_3 = TextLength(Text=cull_2)
larger_2 = LargerThan(FirstNumber=len_3, SecondNumber="3")  # -> LargerThan, OrEqualTo
cull_3 = CullPattern(List=cull_2, CullPattern=larger_2.OrEqualTo)
chars_2 = Characters(Text=cull_3)  # -> Result, Unicode
tmatch_2 = MatchText(Text=chars_2.Result, Pattern="=", Case=True)
panel_3 = Panel(cull_3)
bnd = Bounds(Numbers=tmatch_2)
dedomain = DeconstructDomain(Domain=bnd)  # -> Start, End
trim = TrimTree(Tree=dedomain.End, Depth=1)
cull_4 = CullPattern(List=cull_3, CullPattern=trim)
partition = PartitionList(List=cull_4, Size="4")
rep_6 = ReplaceText(Text=partition, Find="A=", RecursiveReplace=False)
rep_7 = ReplaceText(Text=rep_6, Find="R=", RecursiveReplace=False)
panel_4 = Panel(partition)
rep_8 = ReplaceText(Text=rep_7, Find="G=", RecursiveReplace=False)
rep_9 = ReplaceText(Text=rep_8, Find="B=", RecursiveReplace=False)
tstat = TreeStatistics(Tree=rep_9)  # -> Paths, Length, Count
bnd_2 = Bounds(Numbers=tstat.Length)
item = ListItem(List=rep_9, Index=0, Wrap=True)
item_2 = ListItem(List=rep_9, Index="1", Wrap=True)
item_3 = ListItem(List=rep_9, Index="2", Wrap=True)
item_4 = ListItem(List=rep_9, Index="3", Wrap=True)
for_debug_should_be_4_to_4 = Panel(bnd_2)
rgb = ColourRGB(Alpha=item, Red=item_2, Green=item_3, Blue=item_4)
colors = Data(rgb)
colors_2 = ClusterOutput(colors)
